# Grasshopper definition Hourly Cooling Loads Predictions of AFs using DT & ANN.gh (Grasshopper 0.9.76)
# plug-ins: ProvingGround.Conduit, Mandrill, GH_CPython, TT Toolbox

# ---- group: SOUTH
t1 = ValueList({"Low": "12", "Medium": "28", "High": "44"}, selected="Medium")  # disabled
point = Point(<point referenced from the Rhino model>)  # disabled
point_2 = Point(<point referenced from the Rhino model>)  # disabled
panel = Panel("18")  # disabled
panel_2 = Panel("19")  # disabled
domain_box = DomainBox(Base=[point, point_2], X=panel_2, Y=panel, Z=t1)  # disabled

# ---- group: NORTH
t1_2 = ValueList({"Low": "12", "Medium": "28", "High": "44"}, selected="Medium")  # disabled
point_3 = Point(<point referenced from the Rhino model>)  # disabled
point_4 = Point(<point referenced from the Rhino model>)  # disabled
panel_3 = Panel("18")  # disabled
panel_4 = Panel("26")  # disabled
domain_box_2 = DomainBox(Base=[point_4, point_3], X=panel_4, Y=panel_3, Z=t1_2)  # disabled

# ---- group: WEST
t1_3 = ValueList({"Low": "12", "Medium": "28", "High": "44"}, selected="Medium")  # disabled
point_5 = Point(<point referenced from the Rhino model>)  # disabled
point_6 = Point(<point referenced from the Rhino model>)  # disabled
panel_5 = Panel("22")  # disabled
panel_6 = Panel("18")  # disabled
domain_box_3 = DomainBox(Base=[point_6, point_5], X=panel_6, Y=panel_5, Z=t1_3)  # disabled

# ---- group: EAST
point_7 = Point(<point referenced from the Rhino model>)  # disabled
point_8 = Point(<point referenced from the Rhino model>)  # disabled
t1_4 = ValueList({"Low": "12", "Medium": "28", "High": "44"}, selected="Low")  # disabled
point_9 = Point(<point referenced from the Rhino model>)  # disabled
panel_7 = Panel("22")  # disabled
panel_8 = Panel("19")  # disabled
domain_box_4 = DomainBox(Base=[point_7, point_8, point_9], X=panel_8, Y=panel_7, Z=t1_4)  # disabled

# ---- group: SOUTH
t1_5 = ValueList({"Low": "12", "Medium": "28", "High": "44"}, selected="Low")  # disabled
point_10 = Point(<point referenced from the Rhino model>)  # disabled
point_11 = Point(<point referenced from the Rhino model>)  # disabled
panel_9 = Panel("18")  # disabled
panel_10 = Panel("30")  # disabled
domain_box_5 = DomainBox(Base=[point_11, point_10], X=panel_10, Y=panel_9, Z=t1_5)  # disabled

# ---- group: EAST
t1_6 = ValueList({"Low": "12", "Medium": "28", "High": "44"}, selected="Medium")  # disabled
point_12 = Point(<point referenced from the Rhino model>)  # disabled
point_13 = Point(<point referenced from the Rhino model>)  # disabled
panel_11 = Panel("22")  # disabled
panel_12 = Panel("18")  # disabled
domain_box_6 = DomainBox(Base=[point_13, point_12], X=panel_11, Y=panel_12, Z=t1_6)  # disabled

# ----
point_14 = Point(<point referenced from the Rhino model>)  # disabled
point_15 = Point(<point referenced from the Rhino model>)  # disabled

# ---- group: NORTH
t1_7 = ValueList({"Low": "12", "Medium": "28", "High": "44"}, selected="High")  # disabled
point_16 = Point(<point referenced from the Rhino model>)  # disabled
point_17 = Point(<point referenced from the Rhino model>)  # disabled
panel_13 = Panel("15")  # disabled
panel_14 = Panel("18")  # disabled
domain_box_7 = DomainBox(Base=[point_17, point_16, point_14, point_15], X=panel_13, Y=panel_14, Z=t1_7)  # disabled

# ---- group: Tower
brep = Brep(<brep referenced from the Rhino model>)  # disabled

# ---- group: Tower -Block3
brep_2 = Brep(<brep referenced from the Rhino model>)  # disabled

# ----
number = Number(t1_3)  # disabled
number_2 = Number(t1)  # disabled
number_3 = Number(t1_2)  # disabled
number_4 = Number(t1_4)  # disabled
number_5 = Number(t1_6)  # disabled
number_6 = Number(t1_7)  # disabled
number_7 = Number(t1_5)  # disabled

# ---- group: WEST
t1_8 = ValueList({"Low": "12", "Medium": "28", "High": "44"}, selected="High")  # disabled
point_18 = Point(<point referenced from the Rhino model>)  # disabled
point_19 = Point(<point referenced from the Rhino model>)  # disabled
panel_15 = Panel("25")  # disabled
panel_16 = Panel("15")  # disabled
domain_box_8 = DomainBox(Base=[point_18, point_19], X=panel_16, Y=panel_15, Z=t1_8)  # disabled

# ---- group: NORTH
t1_9 = ValueList({"Low": "12", "Medium": "28", "High": "44"}, selected="Medium")  # disabled
point_20 = Point(<point referenced from the Rhino model>)  # disabled
point_21 = Point(<point referenced from the Rhino model>)  # disabled
panel_17 = Panel("25")  # disabled
panel_18 = Panel("15")  # disabled
domain_box_9 = DomainBox(Base=[point_20, point_21], X=panel_18, Y=panel_17, Z=t1_9)  # disabled

# ---- group: SOUTH
t1_10 = ValueList({"Low": "12", "Medium": "28", "High": "44"}, selected="Low")  # disabled
point_22 = Point(<point referenced from the Rhino model>)  # disabled
point_23 = Point(<point referenced from the Rhino model>)  # disabled
panel_19 = Panel("18")  # disabled
panel_20 = Panel("18")  # disabled
domain_box_10 = DomainBox(Base=[point_22, point_23], X=panel_20, Y=panel_19, Z=t1_10)  # disabled

# ---- group: Office - 24 m Height
brep_3 = Brep(<brep referenced from the Rhino model>)  # disabled

# ----
facade_level = ValueList({"Low": "0.50", "Medium": "1.00", "High": "1.50"}, selected="High")  # disabled
avr = Average(Input=[number_2, number_4, number_3, number])  # disabled
multiplication = Multiplication(A=avr, B=facade_level)  # disabled
facade_level_height = Panel(multiplication)  # disabled
moveaway = MoveAwayFrom(Geometry=brep_3, Emitter=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, Distance=multiplication)  # -> Geometry, Transform; disabled

# ---- group: 48 m
brep_4 = Brep(<brep referenced from the Rhino model>)  # disabled

# ---- group: Tower block2
brep_5 = Brep(<brep referenced from the Rhino model>)  # disabled

# ----
number_8 = Number(t1_9)  # disabled
number_9 = Number(t1_8)  # disabled
number_10 = Number(t1)  # disabled

facade_level_2 = ValueList({"Low": "0.50", "Medium": "1.00", "High": "1.50"}, selected="Low")  # disabled
avr_2 = Average(Input=[number_7, number_5, number_6, number_2])  # disabled
multiplication_2 = Multiplication(A=avr_2, B=facade_level_2)  # disabled
facade_level_height_2 = Panel(multiplication_2)  # disabled
moveaway_2 = MoveAwayFrom(Geometry=brep_4, Emitter=<point referenced from the Rhino model>, Distance=multiplication_2)  # -> Geometry, Transform; disabled

number_11 = Number(t1_10)  # disabled

# ---- group: 10 M / Surface office
brep_6 = Brep(<brep referenced from the Rhino model>)  # disabled

# ----
facade_level_3 = ValueList({"Low": "0.50", "Medium": "1.00", "High": "1.50"}, selected="Low")  # disabled
avr_3 = Average(Input=[number_10, number_11, number_9, number_8])  # disabled
multiplication_3 = Multiplication(A=avr_3, B=facade_level_3)  # disabled
facade_level_height_3 = Panel(multiplication_3)  # disabled
moveaway_3 = MoveAwayFrom(Geometry=brep_6, Emitter=<point referenced from the Rhino model>, Distance=multiplication_3)  # -> Geometry, Transform; disabled

panel_21 = Panel("1")  # disabled
panel_22 = Panel("1")  # disabled
panel_23 = Panel("1")  # disabled
panel_24 = Panel("1")  # disabled
panel_25 = Panel("0.50")  # disabled
panel_26 = Panel("1")  # disabled
panel_27 = Panel("12")  # disabled
panel_28 = Panel("12")  # disabled
panel_29 = Panel("12")  # disabled
panel_30 = Panel("12")  # disabled
panel_31 = Panel("2")  # disabled
rep = ReplaceText(Text=facade_level_3, Find=panel_25, Replace=panel_26, RecursiveReplace=False)  # disabled
panel_32 = Panel("2")  # disabled
panel_33 = Panel("2")  # disabled
rep_2 = ReplaceText(Text=t1_8, Find=panel_27, Replace=panel_21, RecursiveReplace=False)  # disabled
panel_34 = Panel("2")  # disabled
rep_3 = ReplaceText(Text=t1_9, Find=panel_28, Replace=panel_22, RecursiveReplace=False)  # disabled
rep_4 = ReplaceText(Text=t1_10, Find=panel_29, Replace=panel_23, RecursiveReplace=False)  # disabled
rep_5 = ReplaceText(Text=t1_3, Find=panel_30, Replace=panel_24, RecursiveReplace=False)  # disabled
panel_35 = Panel("2")  # disabled
panel_36 = Panel("28")  # disabled
panel_37 = Panel("28")  # disabled
panel_38 = Panel("1.00")  # disabled
panel_39 = Panel("28")  # disabled
panel_40 = Panel("28")  # disabled
rep_6 = ReplaceText(Text=rep, Find=panel_38, Replace=panel_31, RecursiveReplace=False)  # disabled
panel_41 = Panel("3")  # disabled
rep_7 = ReplaceText(Text=rep_4, Find=panel_36, Replace=panel_32, RecursiveReplace=False)  # disabled
panel_42 = Panel("3")  # disabled
rep_8 = ReplaceText(Text=rep_2, Find=panel_37, Replace=panel_33, RecursiveReplace=False)  # disabled
rep_9 = ReplaceText(Text=rep_5, Find=panel_39, Replace=panel_34, RecursiveReplace=False)  # disabled
panel_43 = Panel("3")  # disabled
rep_10 = ReplaceText(Text=rep_3, Find=panel_40, Replace=panel_35, RecursiveReplace=False)  # disabled
panel_44 = Panel("3")  # disabled
panel_45 = Panel("3")  # disabled
panel_46 = Panel("44")  # disabled
panel_47 = Panel("1.50")  # disabled
panel_48 = Panel("44")  # disabled
panel_49 = Panel("44")  # disabled
panel_50 = Panel("44")  # disabled
rep_11 = ReplaceText(Text=rep_6, Find=panel_47, Replace=panel_41, RecursiveReplace=False)  # disabled
rep_12 = ReplaceText(Text=rep_7, Find=panel_46, Replace=panel_42, RecursiveReplace=False)  # disabled
rep_13 = ReplaceText(Text=rep_10, Find=panel_49, Replace=panel_44, RecursiveReplace=False)  # disabled
rep_14 = ReplaceText(Text=rep_8, Find=panel_50, Replace=panel_45, RecursiveReplace=False)  # disabled
rep_15 = ReplaceText(Text=rep_9, Find=panel_48, Replace=panel_43, RecursiveReplace=False)  # disabled

panel_51 = Panel("1")  # disabled
panel_52 = Panel("1")  # disabled
panel_53 = Panel("1")  # disabled
panel_54 = Panel("1")  # disabled
panel_55 = Panel("0.50")  # disabled
panel_56 = Panel("1")  # disabled
panel_57 = Panel("12")  # disabled
panel_58 = Panel("12")  # disabled
panel_59 = Panel("12")  # disabled
panel_60 = Panel("12")  # disabled
panel_61 = Panel("2")  # disabled
rep_16 = ReplaceText(Text=facade_level, Find=panel_55, Replace=panel_56, RecursiveReplace=False)  # disabled
panel_62 = Panel("2")  # disabled
panel_63 = Panel("2")  # disabled
panel_64 = Panel("2")  # disabled
rep_17 = ReplaceText(Text=t1_3, Find=panel_57, Replace=panel_51, RecursiveReplace=False)  # disabled
rep_18 = ReplaceText(Text=t1_2, Find=panel_58, Replace=panel_52, RecursiveReplace=False)  # disabled
rep_19 = ReplaceText(Text=t1, Find=panel_59, Replace=panel_53, RecursiveReplace=False)  # disabled
rep_20 = ReplaceText(Text=t1_4, Find=panel_60, Replace=panel_54, RecursiveReplace=False)  # disabled
panel_65 = Panel("2")  # disabled
panel_66 = Panel("28")  # disabled
panel_67 = Panel("28")  # disabled
panel_68 = Panel("1.00")  # disabled
panel_69 = Panel("28")  # disabled
panel_70 = Panel("28")  # disabled
rep_21 = ReplaceText(Text=rep_16, Find=panel_68, Replace=panel_61, RecursiveReplace=False)  # disabled
panel_71 = Panel("3")  # disabled
panel_72 = Panel("3")  # disabled
rep_22 = ReplaceText(Text=rep_19, Find=panel_66, Replace=panel_62, RecursiveReplace=False)  # disabled
rep_23 = ReplaceText(Text=rep_17, Find=panel_67, Replace=panel_63, RecursiveReplace=False)  # disabled
rep_24 = ReplaceText(Text=rep_20, Find=panel_69, Replace=panel_64, RecursiveReplace=False)  # disabled
panel_73 = Panel("3")  # disabled
rep_25 = ReplaceText(Text=rep_18, Find=panel_70, Replace=panel_65, RecursiveReplace=False)  # disabled
panel_74 = Panel("3")  # disabled
panel_75 = Panel("3")  # disabled
panel_76 = Panel("44")  # disabled
panel_77 = Panel("1.50")  # disabled
panel_78 = Panel("44")  # disabled
panel_79 = Panel("44")  # disabled
panel_80 = Panel("44")  # disabled
rep_26 = ReplaceText(Text=rep_21, Find=panel_77, Replace=panel_71, RecursiveReplace=False)  # disabled
rep_27 = ReplaceText(Text=rep_22, Find=panel_76, Replace=panel_72, RecursiveReplace=False)  # disabled
rep_28 = ReplaceText(Text=rep_25, Find=panel_79, Replace=panel_74, RecursiveReplace=False)  # disabled
rep_29 = ReplaceText(Text=rep_23, Find=panel_80, Replace=panel_75, RecursiveReplace=False)  # disabled
rep_30 = ReplaceText(Text=rep_24, Find=panel_78, Replace=panel_73, RecursiveReplace=False)  # disabled

panel_81 = Panel("1")  # disabled
panel_82 = Panel("1")  # disabled
panel_83 = Panel("1")  # disabled
panel_84 = Panel("1")  # disabled
panel_85 = Panel("0.50")  # disabled
panel_86 = Panel("1")  # disabled
panel_87 = Panel("12")  # disabled
panel_88 = Panel("12")  # disabled
panel_89 = Panel("12")  # disabled
panel_90 = Panel("12")  # disabled
rep_31 = ReplaceText(Text=facade_level_2, Find=panel_85, Replace=panel_86, RecursiveReplace=False)  # disabled
panel_91 = Panel("2")  # disabled
panel_92 = Panel("2")  # disabled
rep_32 = ReplaceText(Text=t1, Find=panel_87, Replace=panel_81, RecursiveReplace=False)  # disabled
panel_93 = Panel("2")  # disabled
rep_33 = ReplaceText(Text=t1_7, Find=panel_88, Replace=panel_82, RecursiveReplace=False)  # disabled
panel_94 = Panel("2")  # disabled
rep_34 = ReplaceText(Text=t1_5, Find=panel_89, Replace=panel_83, RecursiveReplace=False)  # disabled
rep_35 = ReplaceText(Text=t1_6, Find=panel_90, Replace=panel_84, RecursiveReplace=False)  # disabled
panel_95 = Panel("2")  # disabled
panel_96 = Panel("28")  # disabled
panel_97 = Panel("28")  # disabled
panel_98 = Panel("1.00")  # disabled
panel_99 = Panel("28")  # disabled
panel_100 = Panel("28")  # disabled
rep_36 = ReplaceText(Text=rep_31, Find=panel_98, Replace=panel_91, RecursiveReplace=False)  # disabled
panel_101 = Panel("3")  # disabled
rep_37 = ReplaceText(Text=rep_34, Find=panel_96, Replace=panel_92, RecursiveReplace=False)  # disabled
panel_102 = Panel("3")  # disabled
rep_38 = ReplaceText(Text=rep_32, Find=panel_97, Replace=panel_93, RecursiveReplace=False)  # disabled
rep_39 = ReplaceText(Text=rep_35, Find=panel_99, Replace=panel_94, RecursiveReplace=False)  # disabled
panel_103 = Panel("3")  # disabled
rep_40 = ReplaceText(Text=rep_33, Find=panel_100, Replace=panel_95, RecursiveReplace=False)  # disabled
panel_104 = Panel("3")  # disabled
panel_105 = Panel("3")  # disabled
panel_106 = Panel("44")  # disabled
panel_107 = Panel("1.50")  # disabled
panel_108 = Panel("44")  # disabled
panel_109 = Panel("44")  # disabled
panel_110 = Panel("44")  # disabled
rep_41 = ReplaceText(Text=rep_36, Find=panel_107, Replace=panel_101, RecursiveReplace=False)  # disabled
rep_42 = ReplaceText(Text=rep_37, Find=panel_106, Replace=panel_102, RecursiveReplace=False)  # disabled
rep_43 = ReplaceText(Text=rep_40, Find=panel_109, Replace=panel_104, RecursiveReplace=False)  # disabled
rep_44 = ReplaceText(Text=rep_38, Find=panel_110, Replace=panel_105, RecursiveReplace=False)  # disabled
rep_45 = ReplaceText(Text=rep_39, Find=panel_108, Replace=panel_103, RecursiveReplace=False)  # disabled

merge = Merge(Data1=domain_box, Data2=domain_box_4, Data3=domain_box_2, Data4=domain_box_3)  # -> graft(Result); disabled
merge_2 = Merge(Data1=domain_box_5, Data2=domain_box_6, Data3=domain_box_7, Data4=domain_box)  # -> graft(Result); disabled

# ---- group: context buildings block 1
brep_7 = Brep(merge)  # disabled

# ----
brep_8 = Brep(merge_2)  # disabled
merge_3 = Merge(Data1=domain_box_10, Data2=domain_box_8, Data3=domain_box_9, Data4=domain_box_3)  # -> graft(Result); disabled

# ---- group: Building Contexts - block 2
brep_9 = Brep(merge_3)  # disabled

# ----
hours = Slider(9, range=7..18)  # disabled

data = Data(["{56.288624, -43.01, 17.6}", "{56.288624, -43.01, 16.799999}", "{56.288624, -43.01, 16.0}", "{56.288624, -43.01, 15.2}", "{56.288624, -43.01, 14.4}", "{57.088627, -43.01, 17.6}", "{57.088627, -43.01, 16.799999}", "{57.088627, -43.01, 16.0}", "{57.088627, -43.01, 15.2}", "{57.088627, -43.01, 14.4}", "{57.88863, -43.01, 17.6}", "{57.88863, -43.01, 16.799999}", "{57.88863, -43.01, 16.0}", "{57.88863, -43.01, 15.2}", "{57.88863, -43.01, 14.4}", "{58.688629, -43.01, 17.6}", "{58.688629, -43.01, 16.799999}", "{58.688629, -43.01, 16.0}", "{58.688629, -43.01, 15.2}", "{58.688629, -43.01, 14.4}", "{59.488625, -43.01, 17.6}", "{59.488625, -43.01, 16.799999}", "{59.488625, -43.01, 16.0}", "{59.488625, -43.01, 15.2}", "{59.488625, -43.01, 14.4}"])  # disabled
data_2 = Data(["0.66703", "0.66703", "0.660973", "0.660973", "0.654215", "0.66703", "0.66703", "0.660973", "0.660973", "0.654215", "0.66703", "0.660973", "0.660973", "0.654215", "0.654215", "0.66703", "0.660973", "0.660973", "0.654215", "0.654215", "0.660973", "0.660973", "0.660973", "0.654215", "0.654215"])  # disabled

number_slider = Slider(2, range=0..2)  # disabled
number_slider_2 = Slider(0.8, range=0..1)  # disabled

# ---- group: Office Facade
list_item = ListItem(List=[moveaway.Geometry, moveaway_3.Geometry, moveaway_2.Geometry], Index=number_slider, Wrap=True)  # disabled

# ----
number_slider_3 = Slider(1, range=0..1)  # disabled
days = Slider(21, range=1..28)  # disabled
hour = Slider(7, range=1..8760)  # disabled
addition = Addition(A=hours, B=number_slider_3)  # disabled
toggle = BooleanToggle(False)  # disabled
fly = Ladybug_fly(inputSliders=hour, fly=toggle)  # -> Vviiiiiiiiiizzz; disabled; plug-in component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
toggle_2 = BooleanToggle(True)  # disabled
path = FilePath("C:\Users\ammaralammar\Downloads\SAU_Riyadh.404380_IWEC.epw")  # disabled
flip = Flip(Surface=list_item)  # -> Surface, Result; disabled
number_slider_4 = Slider(0.01, range=0..1)  # disabled
toggle_3 = BooleanToggle(True)  # disabled
toggle_4 = BooleanToggle(True)  # disabled
number_slider_5 = Slider(3.2, range=0.5..5)  # disabled
panel_111 = Panel("0.79")  # disabled
point_24 = Point(<point referenced from the Rhino model>)  # disabled

# ---- group: Building Context Block
list_item_2 = ListItem(List=[brep_7, brep_9, brep_8], Index=number_slider, Wrap=True)  # disabled

# ----
brep_10 = Brep([<brep referenced from the Rhino model> x3])  # disabled
swatch = ColourSwatch(SwatchColor=RGBA(168, 168, 168, 183))  # disabled
edges = BrepEdges(Brep=[brep, brep_5, brep_2])  # -> Naked, Interior, NonManifold; disabled
swatch_2 = ColourSwatch(SwatchColor=RGBA(186, 124, 0, 64))  # disabled
swatch_3 = ColourSwatch(SwatchColor=RGB(0, 0, 0))  # disabled
edges_2 = BrepEdges(Brep=[brep_7, brep_9, brep_10, list_item_2, brep_8])  # -> Naked, Interior, NonManifold; disabled
brep_11 = Brep([<brep referenced from the Rhino model> x6])  # disabled
swatch_4 = ColourSwatch(SwatchColor=RGB(191, 191, 191))  # disabled
swatch_5 = ColourSwatch(SwatchColor=RGB(0, 0, 0))  # disabled
preview = CustomPreview(Geometry=[brep, brep_5, brep_2], Shader=swatch_2)  # disabled
preview_2 = CustomPreview(Geometry=[brep_7, brep_9, brep_8, brep_10, list_item_2], Shader=swatch)  # disabled
preview_3 = CustomPreview(Geometry=[edges_2.Naked, edges_2.Interior], Shader=swatch_5)  # disabled
preview_4 = CustomPreview(Geometry=brep_11, Shader=swatch_4)  # disabled
preview_5 = CustomPreview(Geometry=[edges.Naked, edges.Interior], Shader=swatch_3)  # disabled
edges_3 = BrepEdges(Brep=brep_11)  # -> Naked, Interior, NonManifold; disabled
swatch_6 = ColourSwatch(SwatchColor=RGB(0, 0, 0))  # disabled
preview_6 = CustomPreview(Geometry=[edges_3.Naked, edges_3.Interior], Shader=swatch_6)  # disabled

square = Square(Plane=list_item, Size=number_slider_2, ExtentX=5, ExtentY=5)  # -> Cells, Points; disabled

number_slider_6 = Slider(0.85, range=0..1)  # disabled
panel_112 = Panel("0.01")  # disabled
panel_113 = Panel("1.28")  # disabled

# ----
# Orientation
# Building 00
#  Building 01
#        Facade level Height
# Glazing Type - U-value W/m2K
#        Exterior Wall - U-value W/m2K
# AF-(Opening Percentage)
#        AF-Shade Factor
# Solar Radiation W/m2
#        Operative Temperature
# in:Hour
# in:Month '
# in:day
panel_114 = Panel("\"sample_testdata.csv\"")
# ANN Surrogate Model Prediction
# Hourly Cooling Loads Prediction
panel_115 = Panel("""[1	
"High"	
"Medium"
36	
"DBL-Glz001-Clear"	
1	
0.042224	
0.957776		
18.308272
25.736524	
12	
9
21]
[0	
"Low"	
"Low"
12	
"SingleG0"	
0	
0	
1		
203.050085
27.177892	
12	
9
21]""")
panel_116 = Panel("""[0	
"Low"	
"Low"
12	
"SingleG0"	
0	
0	
1	
203.050085	
27.177892	
12	
9
21]
[0	
"Low"	
"Low"
12	
"SingleG0"	
0	
0	
1	
68.930735	
24.588141	
8	
9
21]
 [0	
"Low"	
"Low"
12	
"SingleG0"	
0	
0.465448	
0.534552	
50.960011	
19.611138	
12	
12
21]
 		
 """)

# ---- group: Defining the inputs from a CSV. File, / Hourly Cooling Load Prediction (DT)
gh_cpython = GH_CPython()  # -> output; inputs input: list
# ---------- gh_cpython: Python ----------
# -*- coding: utf-8 -*-
""" 
Python Script
Created on  Sunday July 2021 02:44:56 
@author:  iist 

[desc]
Description of the plugin Here
Write here any thing... 
[/desc]

ARGUMENTS:
----------
<inp> 
    _input :[required] - [type = int] - [default = None] 
    Descripe your input here 
        * bullet point.
        * bullet point
</inp>
<inp>
    Other inputs go here ...
</inp>

RETURN:
----------
    <out>
        output_ : indicate your output description here. \n refers to a new line.
    </out>

"""

import pandas as pd
import numpy as np
import pickle
import matplotlib.pyplot as plt 
import seaborn as sb # used to plot the heatmap

# from sklearn.preprocessing import OneHotEncoder
from sklearn.metrics import mean_squared_error
from sklearn.metrics import mean_absolute_error
# from sklearn.metrics import mean_absolute_percentage_error
from sklearn.metrics import r2_score
# from sklearn.model_selection import train_test_split

from sklearn.preprocessing import OneHotEncoder
from sklearn.metrics import mean_squared_error,  mean_absolute_error, r2_score
from sklearn.model_selection import train_test_split


cat_dims = [2]* 76
emb_dims = [(x, min(50, (x + 1) // 2)) for x in cat_dims]


# In[42]:


filename = 'C:/Users/ammaralammar/Downloads/ghfiles-cooling loads-GH deployment/ghfiles-cooling loads-GH deployment/DT_finalized_model1.sav'
model = pickle.load(open(filename, 'rb'))

# # Data loading and preprocessing

# In[43]:
print(_input)#_input = "sample_testdata.csv"
ln = len(_input) 
#data_test = np.asarray(_input)
data_test = _input



 
# The data is read as a pandas data frame
data = pd.read_csv("C:/Users/ammaralammar/Downloads/ghfiles-cooling loads-GH deployment/ghfiles-cooling loads-GH deployment/dataGH.csv").dropna()
print(data.shape)
data_test = pd.DataFrame(data_test, columns = data.columns)
frames = [data, data_test]

print("The data loaded for testing")
print(data_test)
data = pd.concat(frames)
 
 


from scipy import sparse
# Array that specifies which columns are categorical inputs
categorical_features = [ 'in:Orientation', 'in:Building 00',
       'in:Building 01', 'in:Glazing Type - U-value W/m2K',
       'in:Exterior Wall - U-value W/m2K', 'in:Hour', 'in:Month', 'in:day',] # Except column "7", all are label encoded and "7" is 
                                                               # one-hot encoded. 
# Array that specifies which columns are continuous inputs
contnuous_features = ['in:Facade level Height','in:AF-(Opening Percentage)', 'in:AF-Shade Factor',
       'in:Solar Radiation W/m2', 'in:Operative Temperature']
output_feature = 'out:Cooling Loads - KW/m2'  # specifies which column is output


temp={}
label_encoders = {} 
# for loop starts for label encoding
for i in range(0,len(categorical_features)):
    #codes for one-hot encoding
    label_encoders[categorical_features[i]] = OneHotEncoder(sparse = 'True',handle_unknown='ignore')
    label_encoders[categorical_features[i]].fit(data[categorical_features[i]].values.reshape(-1,1))
    temp[categorical_features[i]]=label_encoders[categorical_features[i]].transform(data[categorical_features[i]].values.reshape(-1,1)).toarray()

ind=1
new_categorical_features=[]
for i in range(0,len(categorical_features)):
    for j in range(0,temp[categorical_features[i]].shape[1]):
        data[str(ind)] = temp[categorical_features[i]][:,j]
        new_categorical_features.append(str(ind)) # Stroing the column identity of newly added one-hot encoded columns as 
                                                  # categorical input.
        ind=ind+1
    data=data.drop([categorical_features[i]], axis=1) # The old column is deleted from the data

# In[51]:


# Array that specifies which columns are categorical inputs
# categorical_features = ["0", "1", "2", "3", "4","5", "6", "7", "8"] # Except column "7", all are label encoded and "7" is 
                                                               # one-hot encoded. 
# Array that specifies which columns are continuous inputs
cat_cols = new_categorical_features
#output_col = "5"  # specifies which column is output
 

test_new =  data.iloc[-ln:,:]
test_new = test_new.values
test = test_new[:,0:len(contnuous_features)] # First 11 columns are taken 
test = np.concatenate((test,test_new[:, (len(contnuous_features)):]),axis=1)  

 

y_pred = model.predict(test) # Prediction corresponding to the test set
y_pred=y_pred.reshape(y_pred.shape[0],1) # Reshaping y_pred for visualization
print("The prediction result:")
print(y_pred)
output_ = y_pred
# In[55]:
# ---------- end gh_cpython ----------

# ---- group: Defining the inputs from a CSV. File,
# Orientation
# Building 00
# Building 01
# Facade level Height
# Glazing Type-U-value
# Exterior Wall-U-value
# AF-(Transmittance)
# AF-Shade Factor
# Solar Radiation
# Operative Temperature
# Hour
# Month
# Day
boolean_toggle = BooleanToggle(True)
file_path = FilePath("C:\Users\ammaralammar\Documents\12-21-Low-Low-0-0.xlsx")
read_excel_sheet = ReadExcelSheet(Run=boolean_toggle, FilePath=file_path, Worksheet="1", Listen=False)  # -> UserMessages, Columns, Rows
hcl_predicted_results_kwh_m2 = Panel(gh_cpython)

# ---- group: Defining the inputs through a panel text / Hourly Cooling Load Prediction (DT)
gh_cpython_2 = GH_CPython()  # -> output; inputs input: list; same code as gh_cpython

# ---- group: Defining the inputs through a panel text
# Orientation
# Building 00
# Building 01
# Facade level Height
# Glazing Type-U-value
# Exterior Wall-U-value
# AF-(Transmittance)
# AF-Shade Factor
# Solar Radiation
# Operative Temperature
# Hour
# Month
# Day
panel_117 = Panel("""[0
"Low"
"Low"
12
"SingleG0"
0
0
1
32.244351
20.454451
0
8
3
21]
[0
"Low"
"Low"
12
"SingleG0"
0
0
1
61.797184
21.03117
0
9
3
21]""")
panel_118 = Panel("""[0
Low
Low
12
SingleG0
0
0
1
61.797184
21.03117
0
9
3
21]
[0
Low
Low
12
SingleG0
0
0
1
116.088757
23.58093
0.005455
12
3
21]
[0
Low
Low
12
SingleG0
0
0
1
82.077993
24.441828
0.022887
15
3
21]""")
inputs = Panel("""[0	
"Low"	
"Low"
12	
"SingleG0"	
0	
0.2	
0.8	
208.519146	
25.84752	
12	
3
21]
[0	
"High"	
"Low"
12	
"SingleG0"	
0	
0	
1	
68.930735	
24.588141	
8	
9
21]
 [0	
"Low"	
"Low"
12	
"DBL-Glz001-Clear"	
0	
0.465448	
0.534552	
120.960011	
21.611138	
12	
12
21]
 [0	
"Low"	
"Medium"
12	
"SingleG0"	
0	
0.465448	
0.534552	
50.960011	
19.611138	
12	
12
21]
 [0	
"High"	
"Medium"
12	
"DBL-Glz001-Clear"	
0	
0.465448	
0.534552	
50.960011	
19.611138	
9	
9
21]""")
hcl_predicted_results_kwh_m2_2 = Panel(gh_cpython_2)

# ---- group: ANN
gh_cpython_3 = GH_CPython()  # -> output; inputs input: list
# ---------- gh_cpython_3: Python ----------
# -*- coding: utf-8 -*-
""" 
Python Script
Created on  Thursday March 2021 11:25:30 
@author:  iist 

[desc]
Description of the plugin Here
Write here any thing... 
[/desc]

ARGUMENTS:
----------
<inp> 
    _input :[required] - [type = int] - [default = None] 
    Descripe your input here 
        * bullet point.
        * bullet point
</inp>
<inp>
    Other inputs go here ...
</inp>

RETURN:
----------
    <out>
        output_ : indicate your output description here. \n refers to a new line.
    </out>

"""

#!/usr/bin/env python
# coding: utf-8

# # Importing the required python libraries
# 
# 

# In[1]:

#!/usr/bin/env python
# coding: utf-8

# # Importing the required python libraries
# 
# 

# In[38]:



import pandas as pd
import numpy as np
# import time
import matplotlib.pyplot as plt 
import seaborn as sb # used to plot the heatmap

# from sklearn.preprocessing import OneHotEncoder
from sklearn.metrics import mean_squared_error
from sklearn.metrics import mean_absolute_error
# from sklearn.metrics import mean_absolute_percentage_error
from sklearn.metrics import r2_score
# from sklearn.model_selection import train_test_split

from sklearn.preprocessing import OneHotEncoder
from sklearn.metrics import mean_squared_error,  mean_absolute_error, r2_score
from sklearn.model_selection import train_test_split

import torch
import torch.nn as nn
import torch.nn.functional as F
from torch.utils.data import Dataset, DataLoader
# torch.manual_seed(0)
# start = time.time()


# In[39]:


class TabularDataset(Dataset):
    def __init__(self, data, cat_cols=None, output_col=None):
        """
        Characterizes a Dataset for PyTorch

        Parameters
        ----------

        data: pandas data frame
        The data frame object for the input data. It must
        contain all the continuous, categorical and the
        output columns to be used.

        cat_cols: List of strings
        The names of the categorical columns in the data.
        These columns will be passed through the embedding
        layers in the model. These columns must be
        label encoded beforehand. 

        output_col: string
        The name of the output variable column in the data
        provided.
        """

        self.n = data.shape[0] # n stores the total number of data points

        if output_col:
            self.y = data[output_col].astype(np.float32).values.reshape(-1, 1) #data[output_col] contains two columns 
                                                                            #(first column is the index). This line converts it 
                                                                            # to single column
            
        else:
            self.y = np.zeros((self.n, 1)) # a general case when out

        self.cat_cols = cat_cols if cat_cols else [] # categorical inputs are stored in "self.cat_cols"
        self.cont_cols = [
            col for col in data.columns if col not in self.cat_cols + [output_col] # finds out the columns that have 
                                                                                   # contionuos inputs
        ]

        if self.cont_cols:
            self.cont_X = data[self.cont_cols].astype(np.float32).values # The data corresponding to 
                                                                         # continuous columns are stored in "self.cont_x"
        else:
            self.cont_X = np.zeros((self.n, 1))

        if self.cat_cols:
            self.cat_X = data[cat_cols].astype(np.int64).values # The data corresponding to 
                                                                # categorical columns are stored in "self.cont_x"
        else:
            self.cat_X = np.zeros((self.n, 1))

    def __len__(self):
        """
        Denotes the total number of samples.
        """
        return self.n

    def __getitem__(self, idx):
        """
        Generates one sample of data as a triplet --> #(output, continous inputs, categorical inputs)
        """
        return [self.y[idx], self.cont_X[idx], self.cat_X[idx]]


# # Definition of the Neural network

# In[40]:


class FeedForwardNN(nn.Module):
    def __init__(
        self,
        emb_dims,
        no_of_cont,
        lin_layer_sizes,
        output_size,
        emb_dropout,
        lin_layer_dropouts,
    ):

        """
        Parameters
        ----------

        emb_dims: List of two element tuples
        This list will contain a two element tuple for each
        categorical feature. The first element of a tuple will
        denote the number of unique values of the categorical
        feature. The second element will denote the embedding
        dimension to be used for that feature.

        no_of_cont: Integer
        The number of continuous features in the data.

        lin_layer_sizes: List of integers.
        The size of each linear layer. The length will be equal
        to the total number
        of linear layers in the network.

        output_size: Integer
        The size of the final output.

        emb_dropout: Float
        The dropout to be used after the embedding layers.

        lin_layer_dropouts: List of floats
        The dropouts to be used after each linear layer.
        """

        super().__init__()

        # Embedding layers of categorical inputs
        self.emb_layers = nn.ModuleList([nn.Embedding(x, y) for x, y in emb_dims])

        no_of_embs = sum([y for x, y in emb_dims])
        self.no_of_embs = no_of_embs
        self.no_of_cont = no_of_cont

        # Linear Layers of the nueral network
        first_lin_layer = nn.Linear(
            self.no_of_embs + self.no_of_cont, lin_layer_sizes[0]
        ) # first layer where data is fed into the network
        # Following lines define the hidden layers
        self.lin_layers = nn.ModuleList(
            [first_lin_layer]
            + [
                nn.Linear(lin_layer_sizes[i], lin_layer_sizes[i + 1])
                for i in range(len(lin_layer_sizes) - 1)
            ]
        )
        # Initializing the weights of neural network layers
        for lin_layer in self.lin_layers:
            nn.init.kaiming_normal_(lin_layer.weight.data)

        # Output Layer
        self.output_layer = nn.Linear(lin_layer_sizes[-1], output_size)
        nn.init.kaiming_normal_(self.output_layer.weight.data)

        # Batch Norm Layers, It is used to normalize the data into the layers to avoid overfitting and to optimize network
        self.first_bn_layer = nn.BatchNorm1d(self.no_of_cont)
        self.bn_layers = nn.ModuleList(
            [nn.BatchNorm1d(size) for size in lin_layer_sizes]
        )

        # Dropout Layers used as regularization
        self.emb_dropout_layer = nn.Dropout(emb_dropout)
        self.droput_layers = nn.ModuleList(
            [nn.Dropout(size) for size in lin_layer_dropouts]
        )

    def forward(self, cont_data, cat_data):
        # This function defines the mathematical operations of the neural network 
        if self.no_of_embs != 0: # Defines the embedding layer of categorical inputs
            x = [
                emb_layer(cat_data[:, i]) for i, emb_layer in enumerate(self.emb_layers)
            ]
            x = torch.cat(x, 1)
            x = self.emb_dropout_layer(x) # dropout regularization of categorical inputs 

        if self.no_of_cont != 0:
            normalized_cont_data = self.first_bn_layer(cont_data) # defines the linear (normal nueral net hidden layer)
                                                                  # for continous inputs

            if self.no_of_embs != 0:
                x = torch.cat([x, normalized_cont_data], 1)
            else:
                x = normalized_cont_data
        # Batch normalization operation is done in this for loop
        for lin_layer, dropout_layer, bn_layer in zip( 
            self.lin_layers, self.droput_layers, self.bn_layers
        ):

            x = F.relu(lin_layer(x))
#             x = F.sigmoid(lin_layer(x))
            x = bn_layer(x)
            x = dropout_layer(x)

        x = self.output_layer(x)

        return x # Returns the output of the network


# In[41]:


cat_dims = [2]* 76
emb_dims = [(x, min(50, (x + 1) // 2)) for x in cat_dims]


# In[42]:


device = torch.device('cpu')
model = FeedForwardNN(emb_dims, no_of_cont=5, lin_layer_sizes=[128], output_size=1, emb_dropout=0.5, lin_layer_dropouts=[0.5]).to(device)
      
model.load_state_dict(torch.load('C:/Users/ammaralammar\Downloads/ghfiles-cooling loads-GH deployment/ghfiles-cooling loads-GH deployment/NN_model.pt', map_location=device))
model.eval()

# # Data loading and preprocessing

# In[43]:
#_input = "sample_testdata.csv"
ln = len(_input)  
data_test = []
for i in range(ln):
    data_test.append(_input[i])

#_input =  pd.read_csv("C:/Users/c1869438/OneDrive - Cardiff University/Desktop/ghfiles-cooling loads-GH deployment/dataGH.csv").dropna()

 
# The data is read as a pandas data frame
data = pd.read_csv("C:/Users/ammaralammar/Downloads/ghfiles-cooling loads-GH deployment/ghfiles-cooling loads-GH deployment/dataGH.csv").dropna()
print(data.shape)
data_test = pd.DataFrame(data_test, columns = data.columns)
frames = [data, data_test]

print("The data loaded for testing")
print(data_test)
data = pd.concat(frames)
 
 


from scipy import sparse
# Array that specifies which columns are categorical inputs
categorical_features = [ 'in:Orientation', 'in:Building 00',
       'in:Building 01', 'in:Glazing Type - U-value W/m2K',
       'in:Exterior Wall - U-value W/m2K', 'in:Hour', 'in:Month', 'in:day',] # Except column "7", all are label encoded and "7" is 
                                                               # one-hot encoded. 
# Array that specifies which columns are continuous inputs
contnuous_features = ['in:Facade level Height','in:AF-(Opening Percentage)', 'in:AF-Shade Factor',
       'in:Solar Radiation W/m2', 'in:Operative Temperature']
output_feature = 'out:Cooling Loads - KW/m2'  # specifies which column is output


temp={}
label_encoders = {} 
# for loop starts for label encoding
for i in range(0,len(categorical_features)):
    #codes for one-hot encoding
    label_encoders[categorical_features[i]] = OneHotEncoder(sparse = 'True',handle_unknown='ignore')
    label_encoders[categorical_features[i]].fit(data[categorical_features[i]].values.reshape(-1,1))
    temp[categorical_features[i]]=label_encoders[categorical_features[i]].transform(data[categorical_features[i]].values.reshape(-1,1)).toarray()

ind=1
new_categorical_features=[]
for i in range(0,len(categorical_features)):
    for j in range(0,temp[categorical_features[i]].shape[1]):
        data[str(ind)] = temp[categorical_features[i]][:,j]
        new_categorical_features.append(str(ind)) # Stroing the column identity of newly added one-hot encoded columns as 
                                                  # categorical input.
        ind=ind+1
    data=data.drop([categorical_features[i]], axis=1) # The old column is deleted from the data

# In[51]:


# Array that specifies which columns are categorical inputs
# categorical_features = ["0", "1", "2", "3", "4","5", "6", "7", "8"] # Except column "7", all are label encoded and "7" is 
                                                               # one-hot encoded. 
# Array that specifies which columns are continuous inputs
cat_cols = new_categorical_features
#output_col = "5"  # specifies which column is output
 


# In[54]:
data = data.iloc[-(data_test.shape[0]+10000):,:] 
# new_categorical_features=test_columns[6:] 
# output_feature=test_columns[5] 
testdataset = TabularDataset(data=data, cat_cols=cat_cols)
                             #output_col=output_col)
batchsize_test=2500
testdataloader = DataLoader(testdataset, batchsize_test, shuffle=False, num_workers=0, drop_last=False)


# In[55]:


predicted=np.zeros((0,1))  # Variable to store neural network prediction
for y, cont_x, cat_x in testdataloader:
        cat_x = cat_x.to(device)
        cont_x = cont_x.to(device)
#         y  = y.to(device)
        preds = model(cont_x, cat_x)
        preds=preds.cpu()
        predicted = np.concatenate((predicted, preds.detach().numpy()),axis=0)
       
# actual = test['5'].values # Variable storing the actual values of the testing cases
# actual=actual.reshape(actual.shape[0],1) # Reshaping for visualization 
# result=np.concatenate((actual, predicted),axis=1) # Actual value and predicted value is stored in "result" variable.
    
# print("Error MEasures:")
# MSE = mean_squared_error(actual, predicted)
# MAE = mean_absolute_error(actual, predicted)
     
# R2 = r2_score(actual, predicted)
# print(MSE)
# print(MAE)
   
# print(R2)
print("Neural netwrok prediction")
print(predicted[-data_test.shape[0]:])
output_ = predicted[-data_test.shape[0]:]
# ---------- end gh_cpython_3 ----------
panel_119 = Panel(gh_cpython_3)

# ----
number_slider_7 = Slider(0.36, range=0..1)
# Visualization
get_viewport_boundary_dimensions = GetViewportBoundaryDimensions(Refresh=True, Origin=Point(0, 0, 0), Scale=0.25, xDim=1493, yDim=1132)
text_split = TextSplit(Separators="[")
vertical_tiles = VerticalTiles(
    Boundary=get_viewport_boundary_dimensions,
    RelativeSizes=Slider(1, range=0..1),
    Width=Slider(0.9, range=0..1),
    WidthPadding=number_slider_7,
    HeightPadding=number_slider_7)
construct_domain = ConstructDomain(DomainStart=Slider(0, range=0..100), DomainEnd=Slider(0.05, range=0..1))
domain = Domain(Start=Slider(0, range=0..100), End=Slider(1, range=0..1))
series = Series(Start=Slider(8, range=0..10), Step=Slider(1, range=0..1), Count=11)
linechartstyle = LineChartStyle(LineColor=RGB(50, 130, 190), Width=1000, Height=500, YAxisLabel="Label", TickMarksX=2)
text_split_2 = TextSplit(Text=text_split, Separators="]")
hcl_predicted_results_kwh_m2_3 = Panel("""0.0        
 0.0        
 0.0        
 0.0        
 0.0        
 0.00295205
 0.00609395
 0.0085772 
0.009405  
 0.0054682 
 0.0037285""")
format = Format(Format="{0}", Culture=127, Data0=series)
linechartdata = LineChartData(Domain=domain)
conduit_font = ConduitFont(
    Font="Arial",
    TextHeight=12,
    AdaptiveHeight=True,
    TextSpacing=1.15,
    Alignment=0,
    Bold=False,
    Italic=False,
    Color=RGB(0, 0, 0))
conduit_colorpalette = ConduitColorPalette(
    Seed=3,
    HueRange=Domain(-0.05, 0.05),
    SaturationRange=Domain(-0.15, 0.15),
    LuminanceRange=Domain(-0.1, 0.1),
    BaseColors=ColourSwatch(SwatchColor=RGB(95, 211, 217)))
panel_120 = Panel("Hourly Cooling Loads KWh/m2")
list_item_3 = ListItem(List=vertical_tiles, Index=Slider(1, range=0..1), Wrap=True)
linechart = LineChart(Data=linechartdata, Style=linechartstyle)
text_trim = TextTrim(Text=text_split_2, Start=True, End=True)
conduit_chart = ConduitChart(
    Bounds=list_item_3,
    Values=hcl_predicted_results_kwh_m2_3,
    Categories=format,
    Title=panel_120,
    CategoryTitle="Hour",
    ValueTitle=panel_120,
    Range=construct_domain,
    ColorPalette=conduit_colorpalette,
    Font=conduit_font)  # -> HUDDrawingObjects, ChartSettings
text_trim_2 = TextTrim(Text=text_split_2, Start=True, End=True)  # -> flatten(Result)
launchwindow = LaunchWindow(Report=linechart, Show=Toggle(True))
cull_index = CullIndex(List=text_trim_2, Indices=[0, -1], Wrap=True)
cull_index_2 = CullIndex(List=text_trim_2, Wrap=True)
heads_up_display_hud = HeadsUpDisplayHUD(
    ShowHUD=Toggle(True),
    DrawingObjects=conduit_chart.HUDDrawingObjects,
    DrawingBoundary=get_viewport_boundary_dimensions,
    ConduitStyleSheet="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")

# ---- group: Defining the inputs from slider components
building_00 = ValueList({"Low": "12", "Medium": "28", "High": "44"}, selected="Low")
building_01 = ValueList({"Low": "12", "Medium": "28", "High": "44"}, selected="Low")
facade_height = ValueList({"Low": "12", "Medium": "28", "High": "44"}, selected="Low")
# DT Surrogate Model Prediction
# Hourly Cooling Loads Prediction
orientation = Slider(0, range=0..3)
glazing_type = Slider(0, range=0..3)
exterior_wall = Slider(0, range=0..2)
solar_radiation = Slider(203, range=0..1000)
operative_temperature = Slider(27, range=18..31)
month = Slider(9, range=0..12)
day = Slider(21, range=0..31)
building_00_2 = ValueList({"Low": "12", "Medium": "28", "High": "44"}, selected="Low")
building_01_2 = ValueList({"Low": "12", "Medium": "28", "High": "44"}, selected="Low")
facade_height_2 = ValueList({"Low": "12", "Medium": "28", "High": "44"}, selected="Low")
af_transmittance = Slider(0.8, range=0..1)
af_shade_factor = Slider(0.2, range=0..1)
hours_2 = Slider(12, range=6..18)
orientation_2 = Slider(0, range=0..3)
glazing_type_2 = Slider(0, range=0..3)
exterior_wall_2 = Slider(0, range=0..2)
af_transmittance_2 = Slider(0.8, range=0..1)
af_shade_factor_2 = Slider(0.2, range=0..1)
solar_radiation_2 = Slider(203, range=0..1000)
operative_temperature_2 = Slider(27, range=18..31)
hours_3 = Slider(12, range=6..18)
month_2 = Slider(9, range=0..12)
day_2 = Slider(21, range=0..31)
building_00_3 = ValueList({"Low": "12", "Medium": "28", "High": "44"}, selected="High")
building_01_3 = ValueList({"Low": "12", "Medium": "28", "High": "44"}, selected="Medium")
facade_height_3 = ValueList({"Low": "12", "Medium": "28", "High": "44"}, selected="Low")
solar_radiation_3 = Slider(203, range=0..1000)
orientation_3 = Slider(1, range=0..3)
glazing_type_3 = Slider(2, range=0..3)
exterior_wall_3 = Slider(0, range=0..2)
af_transmittance_3 = Slider(0.8, range=0..1)
af_shade_factor_3 = Slider(0.2, range=0..1)
operative_temperature_3 = Slider(21, range=18..31)
hours_4 = Slider(12, range=6..18)
month_3 = Slider(9, range=0..12)
day_3 = Slider(21, range=0..31)
panel_121 = Panel("Low")
panel_122 = Panel("Low")
panel_123 = Panel("Low")
panel_124 = Panel("Low")
panel_125 = Panel("SingleG0")
panel_126 = Panel("SingleG0")
panel_127 = Panel("12")
panel_128 = Panel("12")
inputs_2 = Data([orientation_3, building_00_3, day_3, month_3, hours_4, af_shade_factor_3, building_01_3, af_transmittance_3, exterior_wall_3, facade_height_3, glazing_type_3, solar_radiation_3, operative_temperature_3])

# ---- group: Defining the inputs from slider components / Hourly Cooling Load Prediction (DT)
gh_cpython_4 = GH_CPython(
    B00=panel_123,
    B01=panel_124,
    FL=panel_128,
    Glaz=panel_126,
    ExtW=exterior_wall_2,
    Trans=af_transmittance_2,
    SF=af_shade_factor_2,
    SR=solar_radiation_2,
    OT=operative_temperature_2,
    H=hours_3,
    M=month_2,
    D=day_2)  # -> output; inputs Or: list, B00: list, B01: list, FL: list, Glaz: list, ExtW: list, Trans: list, SF: list, SR: list, OT: list, H: list, M: list, D: list
# ---------- gh_cpython_4: Python ----------
# -*- coding: utf-8 -*-
""" 
Python Script
Created on  Friday September 2022 06:36:07 
@author:  ammaralammar 

[desc]
Description of the plugin Here
Write here any thing... 
[/desc]

ARGUMENTS:
----------
<inp> 
    _input :[required] - [type = int] - [default = None] 
    Descripe your input here 
        * bullet point.
        * bullet point
</inp>
<inp>
    Other inputs go here ...
</inp>

RETURN:
----------
    <out>
        output_ : indicate your output description here. \n refers to a new line.
    </out>

"""

import pandas as pd
import numpy as np
import pickle
import matplotlib.pyplot as plt 
import seaborn as sb # used to plot the heatmap

# from sklearn.preprocessing import OneHotEncoder
from sklearn.metrics import mean_squared_error
from sklearn.metrics import mean_absolute_error
# from sklearn.metrics import mean_absolute_percentage_error
from sklearn.metrics import r2_score
# from sklearn.model_selection import train_test_split

from sklearn.preprocessing import OneHotEncoder
from sklearn.metrics import mean_squared_error,  mean_absolute_error, r2_score
from sklearn.model_selection import train_test_split


cat_dims = [2]* 76
emb_dims = [(x, min(50, (x + 1) // 2)) for x in cat_dims]


# In[42]:


filename = 'C:/Users/ammaralammar/Downloads/ghfiles-cooling loads-GH deployment/ghfiles-cooling loads-GH deployment/DT_finalized_model1.sav'
model = pickle.load(open(filename, 'rb'))

# # Data loading and preprocessing

# In[43]:

#data_test = np.asarray(_input)
data_test = [[Or,B00,B01,FL,Glaz,ExtW,Trans,SF,SR,OT,H,M,D]]



 
# The data is read as a pandas data frame
data = pd.read_csv("C:/Users/ammaralammar/Downloads/ghfiles-cooling loads-GH deployment/ghfiles-cooling loads-GH deployment/dataGH.csv").dropna()
print(data.shape)
data_test = pd.DataFrame(data_test, columns = data.columns)
frames = [data, data_test]

print("The data loaded for testing")
print(data_test)
data = pd.concat(frames)
 
 


from scipy import sparse
# Array that specifies which columns are categorical inputs
categorical_features = [ 'in:Orientation', 'in:Building 00',
       'in:Building 01', 'in:Glazing Type - U-value W/m2K',
       'in:Exterior Wall - U-value W/m2K', 'in:Hour', 'in:Month', 'in:day',] # Except column "7", all are label encoded and "7" is 
                                                               # one-hot encoded. 
# Array that specifies which columns are continuous inputs
contnuous_features = ['in:Facade level Height','in:AF-(Opening Percentage)', 'in:AF-Shade Factor',
       'in:Solar Radiation W/m2', 'in:Operative Temperature']
output_feature = 'out:Cooling Loads - KW/m2'  # specifies which column is output


temp={}
label_encoders = {} 
# for loop starts for label encoding
for i in range(0,len(categorical_features)):
    #codes for one-hot encoding
    label_encoders[categorical_features[i]] = OneHotEncoder(sparse = 'True',handle_unknown='ignore')
    label_encoders[categorical_features[i]].fit(data[categorical_features[i]].values.reshape(-1,1))
    temp[categorical_features[i]]=label_encoders[categorical_features[i]].transform(data[categorical_features[i]].values.reshape(-1,1)).toarray()

ind=1
new_categorical_features=[]
for i in range(0,len(categorical_features)):
    for j in range(0,temp[categorical_features[i]].shape[1]):
        data[str(ind)] = temp[categorical_features[i]][:,j]
        new_categorical_features.append(str(ind)) # Stroing the column identity of newly added one-hot encoded columns as 
                                                  # categorical input.
        ind=ind+1
    data=data.drop([categorical_features[i]], axis=1) # The old column is deleted from the data

# In[51]:


# Array that specifies which columns are categorical inputs
# categorical_features = ["0", "1", "2", "3", "4","5", "6", "7", "8"] # Except column "7", all are label encoded and "7" is 
                                                               # one-hot encoded. 
# Array that specifies which columns are continuous inputs
cat_cols = new_categorical_features
#output_col = "5"  # specifies which column is output
 

test_new =  data.iloc[-1:,:]
test_new = test_new.values
test = test_new[:,0:len(contnuous_features)] # First 11 columns are taken 
test = np.concatenate((test,test_new[:, (len(contnuous_features)):]),axis=1)  

 

y_pred = model.predict(test) # Prediction corresponding to the test set
y_pred=y_pred.reshape(y_pred.shape[0],1) # Reshaping y_pred for visualization
print("The prediction result:")
print(y_pred)
output_ = y_pred
# In[55]:
# ---------- end gh_cpython_4 ----------

gh_cpython_5 = GH_CPython(
    x=panel_121,
    y=panel_122,
    xu=panel_127,
    z=panel_125,
    u=exterior_wall,
    v=af_transmittance,
    xz=af_shade_factor,
    w=solar_radiation,
    s=operative_temperature,
    t=hours_2,
    xx=month,
    xy=day)  # -> output; inputs f: list, x: list, y: list, xu: list, z: list, u: list, v: list, xz: list, w: list, s: list, t: list, xx: list, xy: list
# ---------- gh_cpython_5: Python ----------
# -*- coding: utf-8 -*-
""" 
Python Script
Created on  Friday September 2022 06:36:07 
@author:  ammaralammar 

[desc]
Description of the plugin Here
Write here any thing... 
[/desc]

ARGUMENTS:
----------
<inp> 
    _input :[required] - [type = int] - [default = None] 
    Descripe your input here 
        * bullet point.
        * bullet point
</inp>
<inp>
    Other inputs go here ...
</inp>

RETURN:
----------
    <out>
        output_ : indicate your output description here. \n refers to a new line.
    </out>

"""

import pandas as pd
import numpy as np
import pickle
import matplotlib.pyplot as plt 
import seaborn as sb # used to plot the heatmap

# from sklearn.preprocessing import OneHotEncoder
from sklearn.metrics import mean_squared_error
from sklearn.metrics import mean_absolute_error
# from sklearn.metrics import mean_absolute_percentage_error
from sklearn.metrics import r2_score
# from sklearn.model_selection import train_test_split

from sklearn.preprocessing import OneHotEncoder
from sklearn.metrics import mean_squared_error,  mean_absolute_error, r2_score
from sklearn.model_selection import train_test_split


cat_dims = [2]* 76
emb_dims = [(x, min(50, (x + 1) // 2)) for x in cat_dims]


# In[42]:


filename = 'C:/Users/ammaralammar/Downloads/ghfiles-cooling loads-GH deployment/ghfiles-cooling loads-GH deployment/DT_finalized_model1.sav'
model = pickle.load(open(filename, 'rb'))

# # Data loading and preprocessing

# In[43]:

#data_test = np.asarray(_input)
data_test = [[f,x,y,xu,z,u,v,xz,w,s,t,xx,xy]]



 
# The data is read as a pandas data frame
data = pd.read_csv("C:/Users/ammaralammar/Downloads/ghfiles-cooling loads-GH deployment/ghfiles-cooling loads-GH deployment/dataGH.csv").dropna()
print(data.shape)
data_test = pd.DataFrame(data_test, columns = data.columns)
frames = [data, data_test]

print("The data loaded for testing")
print(data_test)
data = pd.concat(frames)
 
 


from scipy import sparse
# Array that specifies which columns are categorical inputs
categorical_features = [ 'in:Orientation', 'in:Building 00',
       'in:Building 01', 'in:Glazing Type - U-value W/m2K',
       'in:Exterior Wall - U-value W/m2K', 'in:Hour', 'in:Month', 'in:day',] # Except column "7", all are label encoded and "7" is 
                                                               # one-hot encoded. 
# Array that specifies which columns are continuous inputs
contnuous_features = ['in:Facade level Height','in:AF-(Opening Percentage)', 'in:AF-Shade Factor',
       'in:Solar Radiation W/m2', 'in:Operative Temperature']
output_feature = 'out:Cooling Loads - KW/m2'  # specifies which column is output


temp={}
label_encoders = {} 
# for loop starts for label encoding
for i in range(0,len(categorical_features)):
    #codes for one-hot encoding
    label_encoders[categorical_features[i]] = OneHotEncoder(sparse = 'True',handle_unknown='ignore')
    label_encoders[categorical_features[i]].fit(data[categorical_features[i]].values.reshape(-1,1))
    temp[categorical_features[i]]=label_encoders[categorical_features[i]].transform(data[categorical_features[i]].values.reshape(-1,1)).toarray()

ind=1
new_categorical_features=[]
for i in range(0,len(categorical_features)):
    for j in range(0,temp[categorical_features[i]].shape[1]):
        data[str(ind)] = temp[categorical_features[i]][:,j]
        new_categorical_features.append(str(ind)) # Stroing the column identity of newly added one-hot encoded columns as 
                                                  # categorical input.
        ind=ind+1
    data=data.drop([categorical_features[i]], axis=1) # The old column is deleted from the data

# In[51]:


# Array that specifies which columns are categorical inputs
# categorical_features = ["0", "1", "2", "3", "4","5", "6", "7", "8"] # Except column "7", all are label encoded and "7" is 
                                                               # one-hot encoded. 
# Array that specifies which columns are continuous inputs
cat_cols = new_categorical_features
#output_col = "5"  # specifies which column is output
 

test_new =  data.iloc[-1:,:]
test_new = test_new.values
test = test_new[:,0:len(contnuous_features)] # First 11 columns are taken 
test = np.concatenate((test,test_new[:, (len(contnuous_features)):]),axis=1)  

 

y_pred = model.predict(test) # Prediction corresponding to the test set
y_pred=y_pred.reshape(y_pred.shape[0],1) # Reshaping y_pred for visualization
print("The prediction result:")
print(y_pred)
output_ = y_pred
# In[55]:
# ---------- end gh_cpython_5 ----------

# ---- group: Defining the inputs from slider components (continued)
cl_predicted_results = Panel(gh_cpython_5)
cl_predicted_results_kwh_m2 = Panel(gh_cpython_4)
